# Grasshopper definition MatchCameraCurveAim.gh (Grasshopper 1.0.7)

# ---- group: Example (Should be Replaced With Robot Arm Data)
crv_rail = Curve(<curve referenced from the Rhino model>)
number_slider = Slider(1, range=0..1)
crv_aim = Curve(<curve referenced from the Rhino model>)

# ----
eval = EvaluateLength(Curve=crv_aim, Length=number_slider, Normalized=True)  # -> Point, Tangent, Parameter

# ---- group: Example (Should be Replaced With Robot Arm Data)
eval_2 = EvaluateLength(Curve=crv_rail, Length=number_slider, Normalized=True)  # -> Point, Tangent, Parameter
Z = UnitZ(Factor=1)
multiplication = Multiplication(A="10000", B=number_slider)
vec2pt = Vector2Pt(PointA=eval_2.Point, PointB=eval.Point, Unitize=False)  # -> Vector, Length
path_mapper = PathMapper(multiplication, source="{A}", target="{0}")
path_mapper_2 = PathMapper(eval_2.Point, source="{A}", target="{1}")
path_mapper_3 = PathMapper(vec2pt.Vector, source="{A}", target="{2}")
path_mapper_4 = PathMapper(Z, source="{A}", target="{3}")

# ----
ln = Line(StartPoint=eval_2.Point, EndPoint=eval.Point)

merge = Merge(Data1=path_mapper, Data2=path_mapper_2, Data3=path_mapper_3, Data4=path_mapper_4)
rec = DataRecorder(merge, DataLimit=-10, RecordData=True)

branch = TreeBranch(Tree=rec, Path="{2}", MaintainPaths=True)
branch_2 = TreeBranch(Tree=rec, Path="{3}", MaintainPaths=True)
branch_3 = TreeBranch(Tree=rec, Path="{1}", MaintainPaths=True)
branch_4 = TreeBranch(Tree=rec, Path="{0}", MaintainPaths=True)
c_script = CSharpScript(export=Button(), obj=branch_4, pts=branch_3, fwd=branch, up=branch_2)  # -> out, P; inputs export: Boolean, obj: list of String, pts: list of Point3d, fwd: list of Vector3d, up: list of Vector3d
# ---------- c_script: C# usings ----------
using System.IO;
using System.Linq;
# ---------- c_script: C# ----------
    if(!export){Print(message);  P = filepath; return;}

    string ghpath = this.Component.OnPingDocument().FilePath;
    string folder = new FileInfo(ghpath).Directory.FullName;
    string name = Path.GetFileNameWithoutExtension(Rhino.RhinoDoc.ActiveDoc.Name);
    filepath = folder + "\\" + name + ".csv";

    //delete file if existing
    if(File.Exists(filepath))
    {
      try{File.Delete(filepath);}
      catch{Print("Close File Before Proceeding"); return;}
    }


    //create data to export to file
    List<string> data = new List<string>();
    string headers = "Time,PositionX,PositionY,PositionZ,ForwardX,ForwardY,ForwardZ,NormalX,NormalY,NormalZ";
    data.Add(headers);
    for(int i = 0;i < obj.Count;i++)
    {
      //get info
      string layer = obj[i];
      Point3d position = pts[i];
      Vector3d forward = fwd[i];
      Vector3d normal = up[i];

      //add info as a row
      string[] info = new string[]{
        layer,
        (-position.X).ToString(),position.Z.ToString(),(-position.Y).ToString(),
        (-forward.X).ToString(),forward.Z.ToString(),(-forward.Y).ToString(),
        (-normal.X).ToString(),normal.Z.ToString(),(-normal.Y).ToString()
        };
      string row = string.Join(",", info);
      data.Add(row);
    }

    //add all data to the file
    System.IO.File.WriteAllLines(filepath, data.ToArray());
    P = filepath;
    message = "Exported: " + filepath;
# ---------- c_script: C# additional code ----------
  string message = "";
  string filepath = "";
# ---------- end c_script ----------
panel = Panel(rec)
panel_2 = Panel(c_script.out)
panel_3 = Panel(c_script.P)
